# Grasshopper definition 230113_bimsc23_datamgmt_Assignment01_GeorgiosBekakos_Tree.gh (Grasshopper 1.0.7)
# Copyright: Marco Juliani

# Rotation Fill
number_slider = Slider(1.99, range=0..10)
# CENTRAL TREE
# Tree Height
# General Scale
tree_height = GetNumber(Slider(446, range=0..1000), AtLeast=1, AtMost=1, Maximum=1.797693135e+308, Minimum=-1.797693135e+308, TreeAccess=False)
pi = Pi(Factor=1)
rotation_fill = GetNumber(number_slider, AtLeast=1, AtMost=1, Maximum=1.797693135e+308, Minimum=-1.797693135e+308, TreeAccess=False)
general_scale = GetNumber(Slider(325, range=0..1000), AtLeast=1, AtMost=1, Maximum=1.797693135e+308, Minimum=-1.797693135e+308, TreeAccess=False)
multiplication = Multiplication(A=pi, B=rotation_fill)
# Branch Relative Height Difference
number_slider_2 = Slider(100, range=0..100)
arc = Arc(Plane=PlaneXY(0, 0, 0), Radius=general_scale, Angle=multiplication)  # -> Arc, Length
# Segmentation
number_slider_3 = Slider(417, range=0..1000)
Z = UnitZ(Factor=tree_height)
pt = ConstructPoint(XCoordinate=0, YCoordinate=0, ZCoordinate=tree_height)
branch_relative_height_difference = GetNumber(number_slider_2, AtLeast=1, AtMost=1, Maximum=1.797693135e+308, Minimum=-1.797693135e+308, TreeAccess=False)
move = Move(Geometry=arc.Arc, Motion=Z)  # -> Geometry, Transform
segmentation = GetNumber(number_slider_3, AtLeast=1, AtMost=1, Maximum=1.797693135e+308, Minimum=-1.797693135e+308, TreeAccess=False)
divide = DivideCurve(Curve=arc.Arc, Count=segmentation, Kinks=False)  # -> Points, Tangents, Parameters
range = Range(Domain=Domain(0, 1), Steps=segmentation)
project = Project(Geometry=pt, Plane=PlaneXY(0, 0, 0))  # -> Geometry, Transform
# Branch Curvature
number_slider_4 = Slider(128, range=0..1000)
graph = GraphMapper(range, x0=0, x1=1, y0=0, y1=1, container_name="Bezier", cpx=[0, 0.6641085148, 0.2549013793, 1], cpy=[0, 0, 1, 1])
# Upper Tree Trunk Size
number_slider_5 = Slider(0.63, range=0..1)
neg = Negative(Value=branch_relative_height_difference)
pt_2 = ConstructPoint(XCoordinate=0, YCoordinate=0, ZCoordinate=0)
vec2pt = Vector2Pt(PointA=divide.Points, PointB=project.Geometry, Unitize=False)  # -> Vector, Length
dom = ConstructDomain(DomainStart=branch_relative_height_difference, DomainEnd=neg)
branch_curvature = GetNumber(number_slider_4, AtLeast=1, AtMost=1, Maximum=1.797693135e+308, Minimum=-1.797693135e+308, TreeAccess=False)
bnd = Bounds(Numbers=graph)
upper_trunk_size = GetNumber(number_slider_5, AtLeast=1, AtMost=1, Maximum=1.797693135e+308, Minimum=-1.797693135e+308, TreeAccess=False)
vec2pt_2 = Vector2Pt(PointA=pt_2, PointB=divide.Points, Unitize=False)  # -> Vector, Length
remap = RemapNumbers(Value=graph, Source=bnd, Target=dom)  # -> Mapped, Clipped
amp = Amplitude(Vector=vec2pt.Vector, Amplitude=branch_curvature)
scale_nu = ScaleNU(Geometry=move.Geometry, Plane=PlaneXY(0, 0, 0), ScaleX=upper_trunk_size, ScaleY=upper_trunk_size, ScaleZ=1)  # -> Geometry, Transform
lng = ListLength(List=vec2pt_2.Vector)
Z_2 = UnitZ(Factor=remap.Mapped)
divide_2 = DivideCurve(Curve=scale_nu.Geometry, Count=segmentation, Kinks=False)  # -> Points, Tangents, Parameters
# Branch Extention Size
number_slider_6 = Slider(48, range=0..100)
neg_2 = Negative(Value=Z_2)
subtraction = Subtraction(A=lng, B="1")
range_2 = Range(Domain=Domain(0, 1), Steps=subtraction)
branch_domain_end = GetNumber(Slider(58, range=0..1000), AtLeast=1, AtMost=1, Maximum=1.797693135e+308, Minimum=-1.797693135e+308, TreeAccess=False)
branch_domain_start = GetNumber(number_slider_6, AtLeast=1, AtMost=1, Maximum=1.797693135e+308, Minimum=-1.797693135e+308, TreeAccess=False)
move_2 = Move(Geometry=divide_2.Points, Motion=neg_2)  # -> Geometry, Transform
graph_2 = GraphMapper(
    range_2,
    x0=0,
    x1=1,
    y0=0,
    y1=1,
    A=1,
    B=0,
    container_name="Linear",
    Graph_x0=0.25,
    Graph_x1=0.75,
    Graph_y0=0.25,
    Graph_y1=0.75)
dom_2 = ConstructDomain(DomainStart=branch_domain_start, DomainEnd=branch_domain_end)
bnd_2 = Bounds(Numbers=graph_2)
remap_2 = RemapNumbers(Value=graph_2, Source=bnd_2, Target=dom_2)  # -> Mapped, Clipped
amp_2 = Amplitude(Vector=vec2pt_2.Vector, Amplitude=Slider(2, range=0..10))
# Branch Height
number_slider_7 = Slider(306, range=0..1000)
multiplication_2 = Multiplication(A=amp_2, B=remap_2.Mapped)
# Lower Tree Trunk Size
number_slider_8 = Slider(0.6, range=0..1)
move_3 = Move(Geometry=divide.Points, Motion=multiplication_2)  # -> Geometry, Transform
branch_ground_relative_height = GetNumber(number_slider_7, AtLeast=1, AtMost=1, Maximum=1.797693135e+308, Minimum=-1.797693135e+308, TreeAccess=False)
lower_trunk_size = GetNumber(number_slider_8, AtLeast=1, AtMost=1, Maximum=1.797693135e+308, Minimum=-1.797693135e+308, TreeAccess=False)
Z_3 = UnitZ(Factor=branch_ground_relative_height)
neg_3 = Negative(Value=amp)
move_4 = Move(Geometry=move_3.Geometry, Motion=Z_3)  # -> Geometry, Transform
scale_nu_2 = ScaleNU(Geometry=divide.Points, Plane=PlaneXY(0, 0, 0), ScaleX=lower_trunk_size, ScaleY=lower_trunk_size, ScaleZ=1)  # -> Geometry, Transform
bezier_span = BezierSpan(StartPoint=move_2.Geometry, StartTangent=amp, EndPoint=scale_nu_2.Geometry, EndTangent=amp)  # -> Curve, Length, Domain
lng_2 = ListLength(List=move_4.Geometry)
ln = Line(StartPoint=move_2.Geometry, EndPoint=scale_nu_2.Geometry)  # disabled
bzspan = BezierSpan(StartPoint=move_2.Geometry, StartTangent=neg_3, EndPoint=move_4.Geometry, EndTangent=amp)  # -> Curve, Length, Domain
dom_3 = ConstructDomain(DomainStart=Slider(20, range=0..100), DomainEnd=Slider(500, range=0..1000))
random = Random(Range=dom_3, Number=lng_2, Seed=2)
amp_3 = Amplitude(Vector=divide.Points, Amplitude=[move_4.Geometry, random])
move_5 = Move(Geometry=move_4.Geometry, Motion=amp_3)  # -> Geometry, Transform
ln_2 = Line(StartPoint=move_4.Geometry, EndPoint=move_5.Geometry)
merge = Merge(Data1=ln, Data3=bzspan.Curve, Data4=bezier_span.Curve)
merge_2 = Merge(Data1=ln, Data2=ln_2, Data3=bzspan.Curve, Data4=bezier_span.Curve)
pipe = Pipe(Curve=[merge, merge_2], Radius=1, Caps=0)
cap_holes = CapHoles(Brep=pipe)
brep_join = BrepJoin(Breps=flatten(cap_holes))  # -> Breps, Closed

# ---- group: RH_OUT:Curves
rh_out_tree = Geometry([merge, merge_2])

# ----
rh_out_tree_2 = Geometry(brep_join.Breps)
ungroup = Ungroup(Group=rh_out_tree_2)

# ---- group: RH_OUT:BAKE
# Join Mesh 1
# draping mesh
# Line in Space not circle - attractor between the meshes
context_bake = ContextBake(Geometry=ungroup)
